# Grasshopper definition binpackingEx.gh (Grasshopper 0.9.76)

panel = Panel("""42859
42859
41881
41881""")
panel_2 = Panel("""24400
24400
24400
24400
24400
24400
24400
24400""")
packingtest = CSharpScript(stuff=panel_2, bin=panel, scale=Toggle(False))  # -> out, stuffTotal, binTotal, packResult; inputs stuff: list of Double, bin: list of Double, scale: Boolean
# ---------- packingtest: C# ----------
    //x ratio
    double stuffSum = stuff.Sum();
    List<double> stuffProportion = new List<double>();
    for(int i = 0;i < stuff.Count;i++)
      stuffProportion.Add(Math.Round(stuff[i] / stuffSum * 100, 2));

    //y ratio
    double binSum = bin.Sum();
    List<double> binProportion = new List<double>();
    for(int i = 0;i < bin.Count;i++)
      binProportion.Add(Math.Round(bin[i] / binSum * 100, 2));


    //binPacking
    List<List<double>> testList = BinPacker.packIt(stuff, bin, scale);


    //A = xProportion;
    stuffTotal = stuffSum;
    //C = yProportion;
    binTotal = binSum;
    packResult = testList;
# ---------- packingtest: C# additional code ----------
  class BinPacker
  {
    public static List<List<double>> packIt(List<double> stuffInitial, List<double> bins, bool scaleStuff)
    {
      //scale
      List<double> scaledStuff = new List<double>();

      double binTotal = bins.Sum();
      double stuffTotal = stuffInitial.Sum();

      if((binTotal < stuffTotal) && scaleStuff)
        scaledStuff = DoubleTools.ScaleToNewSum(binTotal, stuffInitial);
      else
        scaledStuff = stuffInitial;

      //set
      List<Stuff> stuffList = new List<Stuff>();
      for (int i = 0; i < scaledStuff.Count; i++)
      {
        Stuff eachStuff = new Stuff(scaledStuff[i], i);
        stuffList.Add(eachStuff);
      }

      List<BinPack> binList = new List<BinPack>();
      for (int i = 0; i < bins.Count; i++)
      {
        BinPack eachBinPack = new BinPack(bins[i], i);
        binList.Add(eachBinPack);
      }


      //initial sorting
      stuffList.Sort((a, b) => -a.Volume.CompareTo(b.Volume));

      foreach (Stuff i in stuffList)
      {
        binList.Sort((a,b) => BinPackComparer(a, b, i));
        binList.First().StuffIncluded.Add(i);
      }

      //balancing
      BalanceBinPack(binList);
      binList.Sort((a,b) => (a.IndexInitial.CompareTo(b.IndexInitial)));

      //output
      List<List<double>> packedStuff = new List<List<double>>();
      foreach(BinPack i in binList)
      {
        List<double> currentPack = new List<double>();

        i.StuffIncluded.Sort((a,b) => a.IndexInitial.CompareTo(b.IndexInitial));
        foreach(Stuff j in i.StuffIncluded)
          currentPack.Add(j.Volume);

        packedStuff.Add(currentPack);
      }

      return  packedStuff;
    }

    private static void BalanceBinPack(List<BinPack> unbalancedPacks)
    {
      List<List<Stuff>> stuffByTotalDescend = new List<List<Stuff>>();
      unbalancedPacks.Sort((a, b) => -a.GetTotal().CompareTo(b.GetTotal()));

      foreach (BinPack i in unbalancedPacks)
      {
        List<Stuff> tempStuff = new List<Stuff>();

        foreach(Stuff j in i.StuffIncluded)
          tempStuff.Add(new Stuff(j));

        stuffByTotalDescend.Add(tempStuff);
      }

      unbalancedPacks.Sort((a, b) => -a.Volume.CompareTo(b.Volume));
      for(int i = 0; i < unbalancedPacks.Count;i++)
        unbalancedPacks[i].StuffIncluded = stuffByTotalDescend[i];

      return;
    }

    private static int BinPackComparer(BinPack a, BinPack b, Stuff s)
    {
      //tolerance
      double nearDecidingRate = 1.2;

      //binPackSet
      double aVolume = a.Volume;
      double bVolume = b.Volume;

      double aRemain = a.GetRemain();
      double bRemain = b.GetRemain();

      double aProperity = Math.Abs(a.GetRemain() - s.Volume);
      double cProperity = Math.Abs(b.GetRemain() - s.Volume);

      double sVolume = s.Volume;

      //decider
      bool IsAMoreProper = aProperity < cProperity;


      //
      if (aVolume <= 0)
      {
        if (bVolume <= 0)
        {
          if (IsAMoreProper)
            return -1;
          return 1;
        }

        if (bRemain >= sVolume)
          return 1;
        else
        {
          if (IsAMoreProper)
            return -1;
          return 1;
        }
      }
      else
      {
        if (bVolume <= 0)
        {
          if (aRemain >= sVolume)
            return -1;
          else
          {
            if (IsAMoreProper)
              return -1;
            return 1;
          }
        }

        if (aRemain <= sVolume)
        {
          if (bRemain <= sVolume)
          {
            if (IsAMoreProper)
              return -1;
            return 1;
          }

          if (aRemain * nearDecidingRate >= sVolume)
            return -1;
          return 1;
        }

        if (bRemain <= sVolume)
        {
          if (bRemain * nearDecidingRate >= sVolume)
            return 1;
          return -1;
        }

        if (IsAMoreProper)
          return -1;
        return 1;
      }
    }

    private class Stuff
    {
      public Stuff(double volume, int indexInitial)
      {
        this.Volume = volume;
        this.IndexInitial = indexInitial;
      }

      public Stuff(Stuff otherStuff)
      {
        this.Volume = otherStuff.Volume;
        this.IndexInitial = otherStuff.IndexInitial;
      }

      public double Volume { get; set; }
      public int IndexInitial { get; set;}
    }

    private class BinPack
    {
      private List<Stuff> stuffIncluded = new List<Stuff>();
      public BinPack(double volume, int indexInitial)
      {
        this.Volume = volume;
        this.IndexInitial = indexInitial;
      }

      //
      public double GetRemain()
      {
        double stuffTotal = GetTotal();
        return Volume - stuffTotal;
      }

      public double GetTotal()
      {
        double stuffTotal = 0;
        if (StuffIncluded.Count != 0)
        {
          foreach (Stuff i in StuffIncluded)
            stuffTotal += i.Volume;
        }

        return stuffTotal;
      }

      public double Volume { get; private set; }
      public int IndexInitial { get; private set; }
      public List<Stuff> StuffIncluded { get { return stuffIncluded; } set { stuffIncluded = value as List<Stuff>; } }
    }


  }


  class DoubleTools
  {
    public static double SumDouble(List<double> doubleList)
    {
      double result = new double();

      foreach (double i in doubleList)
        result += i;

      return result;
    }

    public static List<double> GetPercentage(List<double> doubleList, int decimals)
    {
      List<double> proportions = new List<double>();

      double sum = SumDouble(doubleList);
      foreach (double i in doubleList)
        proportions.Add(Math.Round((i / sum) * 100, decimals));

      return proportions;
    }

    public static List<double> ScaleToNewSum(double newSum, List<double> oldPortions)
    {
      List<double> newPortions = new List<double>();

      double oldSum = SumDouble(oldPortions);
      foreach (double i in oldPortions)
        newPortions.Add(newSum * (i / oldSum));

      return newPortions;
    }
  }
# ---------- end packingtest ----------
c_script = CSharpScript(x=packingtest.packResult)  # -> out, A
# ---------- c_script: C# ----------
    A = x;
# ---------- end c_script ----------
panel_3 = Panel(c_script.A)
panel_4 = Panel(packingtest.out)
panel_5 = Panel(packingtest.stuffTotal)
panel_6 = Panel(packingtest.binTotal)
ma = MassAddition(Input=panel_3)  # -> flatten(Result), PartialResults
subtraction = Subtraction(A=panel, B=ma.Result)
abs = Absolute(Value=subtraction)
ma_2 = MassAddition(Input=abs)  # -> Result, PartialResults
panel_7 = Panel(ma.Result)
panel_8 = Panel(subtraction)
panel_9 = Panel(ma_2.Result)
